# Grasshopper definition A2-00.gh (Grasshopper 1.0.8)

base_size = Slider(50, range=-10..100)
material_depth = Slider(1.6, range=0..10)

# ---- group: Score properties
starting_point = Slider(0, range=0..20)
dash = Slider(1.15, range=0..20)
rectangle = Rectangle(Plane=PlaneXY(0, 0, 0), XSize=dash, YSize=starting_point, Radius=0)  # -> Rectangle, Length
n = Slider(5, range=0..20)
linear_array = LinearArray(Geometry=rectangle.Rectangle, Direction=Vector(10, 0, 0), Count=n)  # -> Geometry, Transform

# ----
material_thickness = Panel(material_depth)
base_size_2 = Panel(base_size)
base_size_3 = Panel(base_size)
material_thicknesss = Panel(material_depth)
base_size_4 = Panel(base_size)
base_size_5 = Panel(base_size)
material_thicknesss_2 = Panel(material_depth)
material_thicknesss_3 = Panel(material_depth)
base_size_6 = Panel(base_size)
material_thicknesss_4 = Panel(material_depth)
base_size_7 = Panel(base_size)
material_thickness_2 = Panel(material_depth)
base_size_8 = Panel(base_size)
material_thickness_3 = Panel(material_depth)
base_width_4 = Slider(4, range=0..10)

# ---- group: Side tab
base_width_4_2 = Slider(-4, range=-10..10)
base_width_4_3 = Slider(3, range=0..10)
division = Division(A=base_size_3, B=base_width_4_2)
division_2 = Division(A=base_size_3, B=base_width_4_3)
rectangle_2 = Rectangle(Plane=PlaneXY(0, 0, 0), XSize=division_2, YSize=base_size_3, Radius=Slider(6, range=0..10))  # -> Rectangle, Length
vector_xyz = VectorXYZ(XComponent=division, YComponent=0, ZComponent=0)  # -> Vector, Length
move = Move(Geometry=rectangle_2.Rectangle, Motion=vector_xyz.Vector)  # -> Geometry, Transform
unit_z = UnitZ(Factor=material_thicknesss)
extrude = Extrude(Base=move.Geometry, Direction=unit_z)
cap_holes = CapHoles(Brep=extrude)

# ---- group: Base rectangle
rectangle_3 = Rectangle(Plane=PlaneXY(0, 0, 0), XSize=base_size_7, YSize=base_size_7, Radius=0)  # -> Rectangle, Length
box_rectangle = BoxRectangle(Rectangle=rectangle_3.Rectangle, Height=material_thickness_2)

# ----
base_width_4_4 = Slider(4, range=0..10)

# ---- group: Tab slots
piece_width_8 = Slider(8, range=0..10)
division_3 = Division(A=base_size_6, B=base_width_4)
division_4 = Division(A=base_size_6, B=piece_width_8)
piece_width_2 = Slider(2, range=0..10)
addition = Addition(A=base_size_6, B=material_thicknesss_4)
rectangle_4 = Rectangle(Plane=PlaneXY(0, 0, 0), XSize=division_3, YSize=material_thicknesss_4, Radius=0)  # -> Rectangle, Length
vector_xyz_2 = VectorXYZ(XComponent=division_4, YComponent=addition, ZComponent=0)  # -> Vector, Length
division_5 = Division(A=base_size_6, B=piece_width_2)
move_2 = Move(Geometry=rectangle_4.Rectangle, Motion=vector_xyz_2.Vector)  # -> Geometry, Transform
vector_xyz_3 = VectorXYZ(XComponent=division_5, YComponent=0, ZComponent=0)  # -> Vector, Length
n_2 = Slider(2, range=0..10)
linear_array_2 = LinearArray(Geometry=move_2.Geometry, Direction=vector_xyz_3.Vector, Count=n_2)  # -> Geometry, Transform
unit_z_2 = UnitZ(Factor=base_size_6)
extrude_2 = Extrude(Base=linear_array_2.Geometry, Direction=unit_z_2)
cap_holes_2 = CapHoles(Brep=extrude_2)

# ---- group: Insert base
base_width_3 = Slider(3, range=0..10)
base_width_8 = Slider(8, range=0..10)
base_width_2 = Slider(2, range=0..10)
insert_2 = Slider(-2, range=-20..10)
division_6 = Division(A=base_size_4, B=base_width_4_4)
division_7 = Division(A=base_size_4, B=material_thicknesss_2)
division_8 = Division(A=base_size_4, B=base_width_3)
division_9 = Division(A=base_size_4, B=base_width_8)
division_10 = Division(A=division_8, B=insert_2)
division_11 = Division(A=base_size_4, B=base_width_2)
vector_xyz_4 = VectorXYZ(XComponent=division_9, YComponent=division_10, ZComponent=0)  # -> Vector, Length
rectangle_5 = Rectangle(Plane=PlaneXY(0, 0, 0), XSize=division_6, YSize=division_8, Radius=division_7)  # -> Rectangle, Length
n_3 = Slider(2, range=0..10)
vector_xyz_5 = VectorXYZ(XComponent=division_11, YComponent=0, ZComponent=0)  # -> Vector, Length
move_3 = Move(Geometry=rectangle_5.Rectangle, Motion=vector_xyz_4.Vector)  # -> Geometry, Transform
linear_array_3 = LinearArray(Geometry=move_3.Geometry, Direction=vector_xyz_5.Vector, Count=n_3)  # -> Geometry, Transform
unit_z_3 = UnitZ(Factor=material_thicknesss_2)
extrude_3 = Extrude(Base=linear_array_3.Geometry, Direction=unit_z_3)
cap_holes_3 = CapHoles(Brep=extrude_3)

# ---- group: Insert friction
base_width_8_2 = Slider(8, range=0..10)
insert_base_1 = Slider(-1, range=-20..10)
division_12 = Division(A=base_size_5, B=base_width_8_2)
division_13 = Division(A=division_6, B=insert_base_1)
vector_xyz_6 = VectorXYZ(XComponent=division_9, YComponent=division_13, ZComponent=0)  # -> Vector, Length
rectangle_6 = Rectangle(Plane=PlaneXY(0, 0, 0), XSize=division_6, YSize=division_12, Radius=division_7)  # -> Rectangle, Length
n_4 = Slider(2, range=0..10)
move_4 = Move(Geometry=rectangle_6.Rectangle, Motion=vector_xyz_6.Vector)  # -> Geometry, Transform
vector_xyz_7 = VectorXYZ(XComponent=division_11, YComponent=0, ZComponent=0)  # -> Vector, Length
linear_array_4 = LinearArray(Geometry=move_4.Geometry, Direction=vector_xyz_7.Vector, Count=n_4)  # -> Geometry, Transform
unit_z_4 = UnitZ(Factor=material_thicknesss_3)
extrude_4 = Extrude(Base=linear_array_4.Geometry, Direction=unit_z_4)
cap_holes_4 = CapHoles(Brep=extrude_4)

# ---- group: Tabs
base_width_4_5 = Slider(4, range=0..10)
sides = Slider(6, range=0..10)
piece_width_2_2 = Slider(2, range=0..10)
division_14 = Division(A=base_size_7, B=base_width_4_5)
polygon = Polygon(Plane=PlaneXY(0, 0, 0), Radius=division_14, Segments=sides, FilletRadius=0)  # -> Polygon, Length
vector_xyz_8 = VectorXYZ(XComponent=division_14, YComponent=base_size_7, ZComponent=0)  # -> Vector, Length
division_15 = Division(A=base_size_7, B=piece_width_2_2)
vector_xyz_9 = VectorXYZ(XComponent=division_15, YComponent=0, ZComponent=0)  # -> Vector, Length
move_5 = Move(Geometry=polygon.Polygon, Motion=vector_xyz_8.Vector)  # -> Geometry, Transform
n_5 = Slider(2, range=0..10)
linear_array_5 = LinearArray(Geometry=move_5.Geometry, Direction=vector_xyz_9.Vector, Count=n_5)  # -> Geometry, Transform
unit_z_5 = UnitZ(Factor=material_thickness_2)
extrude_5 = Extrude(Base=linear_array_5.Geometry, Direction=unit_z_5)
cap_holes_5 = CapHoles(Brep=extrude_5)

# ---- group: Side tab scores
construct_point = ConstructPoint(XCoordinate=0, YCoordinate=base_size_8, ZCoordinate=material_thickness_3)
construct_point_2 = ConstructPoint(XCoordinate=0, YCoordinate=0, ZCoordinate=material_thickness_3)
line = Line(StartPoint=construct_point_2, EndPoint=construct_point)
vector_xyz_10 = VectorXYZ(XComponent=base_size_8, YComponent=0, ZComponent=0)  # -> Vector, Length
right_dash = DashPattern(Curve=line, Pattern=linear_array.Geometry)  # -> Dashes, Gaps
mirror = Mirror(Geometry=right_dash.Dashes, Plane=PlaneYZ(0, 0, 0))  # -> Geometry, Transform
move_6 = Move(Geometry=mirror.Geometry, Motion=vector_xyz_10.Vector)  # -> Geometry, Transform

# ---- group: Tab score
construct_point_3 = ConstructPoint(XCoordinate=base_size_8, YCoordinate=base_size_8, ZCoordinate=material_thickness_3)
construct_point_4 = ConstructPoint(XCoordinate=0, YCoordinate=base_size_8, ZCoordinate=material_thickness_3)
line_2 = Line(StartPoint=construct_point_4, EndPoint=construct_point_3)
right_dash_2 = DashPattern(Curve=line_2, Pattern=linear_array.Geometry)  # -> Dashes, Gaps
move_7 = Move(Geometry=right_dash_2.Dashes, Motion=Vector(0, 0, 10))  # -> Geometry, Transform

# ----
base_size_9 = Panel(base_size)
solid_difference = SolidDifference(BrepsA=cap_holes_5, BrepsB=cap_holes_2)
solid_union = SolidUnion(Breps=[cap_holes_3, cap_holes_4])

# ---- group: Side slot
number_slider = Slider(-1, range=-10..1)
multiplication = Multiplication(A=material_thickness, B=Slider(2, range=0..10))
division_16 = Division(A=base_size_2, B=Slider(2, range=0..10))
rectangle_7 = Rectangle(Plane=PlaneXY(0, 0, 0), XSize=material_thickness, YSize=division_16, Radius=0)  # -> Rectangle, Length
unit_z_6 = UnitZ(Factor=base_size_2)

# ----
multiplication_2 = Multiplication(A=multiplication, B=number_slider)

# ---- group: Side slot (continued)
vector_xyz_11 = VectorXYZ(XComponent=multiplication_2, YComponent=0, ZComponent=0)  # -> Vector, Length
move_8 = Move(Geometry=rectangle_7.Rectangle, Motion=vector_xyz_11.Vector)  # -> Geometry, Transform
extrude_6 = Extrude(Base=move_8.Geometry, Direction=unit_z_6)
cap_holes_6 = CapHoles(Brep=extrude_6)

# ----
solid_difference_2 = SolidDifference(BrepsA=cap_holes, BrepsB=cap_holes_6)

# ---- group: Side tab - Right
rotate = Rotate(Geometry=solid_difference_2, Angle=degrees(Slider(180, range=0..1000)), Plane=PlaneXY(0, 0, 0))  # -> Geometry, Transform
vector_xyz_12 = VectorXYZ(XComponent=base_size_9, YComponent=base_size_9, ZComponent=0)  # -> Vector, Length
move_9 = Move(Geometry=rotate.Geometry, Motion=vector_xyz_12.Vector)  # -> Geometry, Transform

# ----
solid_union_2 = SolidUnion(Breps=[solid_difference_2, solid_union, solid_difference, box_rectangle, move_9.Geometry])

# ---- group: Triangles / Score path
number_slider_2 = Slider(2, range=0..10)
y = Slider(0, range=-10..10)
construct_point_5 = ConstructPoint(XCoordinate=base_size_8, YCoordinate=y, ZCoordinate=material_thickness_3)

# ---- group: Triangles
division_17 = Division(A=base_size_8, B=number_slider_2)
n_6 = Slider(0, range=0..20)
vector_xyz_13 = VectorXYZ(XComponent=base_size_8, YComponent=n_6, ZComponent=0)  # -> Vector, Length

# ---- group: Triangles / Score path (continued)
construct_point_6 = ConstructPoint(XCoordinate=division_17, YCoordinate=base_size_8, ZCoordinate=material_thickness_3)
line_3 = Line(StartPoint=construct_point_5, EndPoint=construct_point_6)

# ---- group: Triangles (continued)
right_dash_3 = DashPattern(Curve=line_3, Pattern=linear_array.Geometry)  # -> Dashes, Gaps
mirror_2 = Mirror(Geometry=right_dash_3.Dashes, Plane=PlaneYZ(0, 0, 0))  # -> Geometry, Transform
left_dash_move = Move(Geometry=mirror_2.Geometry, Motion=vector_xyz_13.Vector)  # -> Geometry, Transform

# ----
merge = Merge(
    Data1=right_dash_3.Dashes,
    Data2=left_dash_move.Geometry,
    Data3=move_6.Geometry,
    Data4=right_dash.Dashes,
    Data5=move_7.Geometry)
