# Grasshopper definition A2-01.gh (Grasshopper 1.0.8)

base_size = Slider(50, range=-10..100)
material_depth = Slider(1.6, range=0..10)

# ---- group: Score properties
starting_point = Slider(0, range=0..20)
dash = Slider(1.15, range=0..20)
rectangle = Rectangle(Plane=PlaneXY(0, 0, 0), XSize=dash, YSize=starting_point, Radius=0)  # -> Rectangle, Length
n = Slider(5, range=0..20)
linear_array = LinearArray(Geometry=rectangle.Rectangle, Direction=Vector(10, 0, 0), Count=n)  # -> Geometry, Transform

# ----
material_thickness = Panel(material_depth)
base_size_2 = Panel(base_size)
base_size_3 = Panel(base_size)
material_thicknesss = Panel(material_depth)
base_size_4 = Panel(base_size)
material_thicknesss_2 = Panel(material_depth)
base_size_5 = Panel(base_size)
base_size_6 = Panel(base_size)
material_thicknesss_3 = Panel(material_depth)
material_thicknesss_4 = Panel(material_depth)
base_size_7 = Panel(base_size)
material_thickness_2 = Panel(material_depth)
base_size_8 = Panel(base_size)
material_thickness_3 = Panel(material_depth)
base_width_4 = Slider(4, range=0..10)

# ---- group: Side tab
base_width_4_2 = Slider(-4, range=-10..10)
n_2 = Slider(1, range=0..10)
division = Division(A=base_size_3, B=base_width_4_2)
division_2 = Division(A=base_size_3, B=n_2)
rectangle_2 = Rectangle(Plane=PlaneXY(0, 0, 0), XSize=division_2, YSize=base_size_3, Radius=Slider(6, range=0..10))  # -> Rectangle, Length
vector_xyz = VectorXYZ(XComponent=division, YComponent=0, ZComponent=0)  # -> Vector, Length
move = Move(Geometry=rectangle_2.Rectangle, Motion=vector_xyz.Vector)  # -> Geometry, Transform
unit_z = UnitZ(Factor=material_thicknesss)
extrude = Extrude(Base=move.Geometry, Direction=unit_z)
cap_holes = CapHoles(Brep=extrude)

# ---- group: Base rectangle
rectangle_3 = Rectangle(Plane=PlaneXY(0, 0, 0), XSize=base_size_7, YSize=base_size_7, Radius=0)  # -> Rectangle, Length
box_rectangle = BoxRectangle(Rectangle=rectangle_3.Rectangle, Height=material_thickness_2)

# ----
base_width_4_3 = Slider(4, range=0..10)

# ---- group: Side tab scores
construct_point = ConstructPoint(XCoordinate=0, YCoordinate=base_size_8, ZCoordinate=material_thickness_3)
construct_point_2 = ConstructPoint(XCoordinate=0, YCoordinate=0, ZCoordinate=material_thickness_3)
line = Line(StartPoint=construct_point_2, EndPoint=construct_point)
vector_xyz_2 = VectorXYZ(XComponent=base_size_8, YComponent=0, ZComponent=0)  # -> Vector, Length
right_dash = DashPattern(Curve=line, Pattern=linear_array.Geometry)  # -> Dashes, Gaps
mirror = Mirror(Geometry=right_dash.Dashes, Plane=PlaneYZ(0, 0, 0))  # -> Geometry, Transform
move_2 = Move(Geometry=mirror.Geometry, Motion=vector_xyz_2.Vector)  # -> Geometry, Transform

# ---- group: Tab score
construct_point_3 = ConstructPoint(XCoordinate=base_size_8, YCoordinate=0, ZCoordinate=0)
construct_point_4 = ConstructPoint(XCoordinate=0, YCoordinate=0, ZCoordinate=0)
line_2 = Line(StartPoint=construct_point_4, EndPoint=construct_point_3)
right_dash_2 = DashPattern(Curve=line_2, Pattern=linear_array.Geometry)  # -> Dashes, Gaps
move_3 = Move(Geometry=right_dash_2.Dashes, Motion=Vector(0, 0, 10))  # -> Geometry, Transform

# ----
vector_xyz_3 = VectorXYZ(XComponent=0, YComponent=base_size_5, ZComponent=0)  # -> Vector, Length
vector_xyz_4 = VectorXYZ(XComponent=0, YComponent=base_size_4, ZComponent=0)  # -> Vector, Length
base_size_9 = Panel(base_size)

# ---- group: Side slot
number_slider = Slider(-1, range=-10..1)
multiplication = Multiplication(A=material_thickness, B=Slider(2, range=0..10))
division_3 = Division(A=base_size_2, B=Slider(2, range=0..10))
rectangle_4 = Rectangle(Plane=PlaneXY(0, 0, 0), XSize=material_thickness, YSize=division_3, Radius=0)  # -> Rectangle, Length
unit_z_2 = UnitZ(Factor=base_size_2)

# ----
multiplication_2 = Multiplication(A=multiplication, B=number_slider)

# ---- group: Side slot (continued)
vector_xyz_5 = VectorXYZ(XComponent=multiplication_2, YComponent=0, ZComponent=0)  # -> Vector, Length
move_4 = Move(Geometry=rectangle_4.Rectangle, Motion=vector_xyz_5.Vector)  # -> Geometry, Transform
extrude_2 = Extrude(Base=move_4.Geometry, Direction=unit_z_2)
cap_holes_2 = CapHoles(Brep=extrude_2)

# ----
solid_difference = SolidDifference(BrepsA=cap_holes, BrepsB=cap_holes_2)

# ---- group: Side tab - Right
rotate = Rotate(Geometry=solid_difference, Angle=degrees(Slider(180, range=0..1000)), Plane=PlaneXY(0, 0, 0))  # -> Geometry, Transform
vector_xyz_6 = VectorXYZ(XComponent=base_size_9, YComponent=base_size_9, ZComponent=0)  # -> Vector, Length
move_5 = Move(Geometry=rotate.Geometry, Motion=vector_xyz_6.Vector)  # -> Geometry, Transform

# ---- group: Tab slots
piece_width_8 = Slider(8, range=0..10)
division_4 = Division(A=base_size_6, B=base_width_4)
division_5 = Division(A=base_size_6, B=piece_width_8)
piece_width_2 = Slider(2, range=0..10)
addition = Addition(B=material_thicknesss_3)
rectangle_5 = Rectangle(Plane=PlaneXY(0, 0, 0), XSize=division_4, YSize=material_thicknesss_3, Radius=0)  # -> Rectangle, Length
vector_xyz_7 = VectorXYZ(XComponent=division_5, YComponent=addition, ZComponent=0)  # -> Vector, Length
division_6 = Division(A=base_size_6, B=piece_width_2)
move_6 = Move(Geometry=rectangle_5.Rectangle, Motion=vector_xyz_7.Vector)  # -> Geometry, Transform
vector_xyz_8 = VectorXYZ(XComponent=division_6, YComponent=0, ZComponent=0)  # -> Vector, Length
n_3 = Slider(2, range=0..10)
linear_array_2 = LinearArray(Geometry=move_6.Geometry, Direction=vector_xyz_8.Vector, Count=n_3)  # -> Geometry, Transform
unit_z_3 = UnitZ(Factor=base_size_6)

# ----
rotate_axis = RotateAxis(Geometry=linear_array_2.Geometry, Angle=degrees(Slider(180, range=0..1000)), Axis=Line((0, 0, 0), (10, 0, 0)))  # -> Geometry, Transform

# ---- group: Tab slots (continued)
extrude_3 = Extrude(Base=rotate_axis.Geometry, Direction=unit_z_3)
cap_holes_3 = CapHoles(Brep=extrude_3)

# ---- group: Insert base
base_width_3 = Slider(3, range=0..10)
base_width_8 = Slider(8, range=0..10)
base_width_2 = Slider(2, range=0..10)
insert_2 = Slider(-2, range=-20..10)
division_7 = Division(A=base_size_4, B=base_width_4_3)
division_8 = Division(A=base_size_4, B=material_thicknesss_2)
division_9 = Division(A=base_size_4, B=base_width_3)
division_10 = Division(A=base_size_4, B=base_width_8)
division_11 = Division(A=base_size_4, B=base_width_2)
division_12 = Division(A=division_9, B=insert_2)
vector_xyz_9 = VectorXYZ(XComponent=division_10, YComponent=division_12, ZComponent=0)  # -> Vector, Length
rectangle_6 = Rectangle(Plane=PlaneXY(0, 0, 0), XSize=division_7, YSize=division_9, Radius=division_8)  # -> Rectangle, Length
n_4 = Slider(2, range=0..10)
vector_xyz_10 = VectorXYZ(XComponent=division_11, YComponent=0, ZComponent=0)  # -> Vector, Length
move_7 = Move(Geometry=rectangle_6.Rectangle, Motion=vector_xyz_9.Vector)  # -> Geometry, Transform
linear_array_3 = LinearArray(Geometry=move_7.Geometry, Direction=vector_xyz_10.Vector, Count=n_4)  # -> Geometry, Transform
unit_z_4 = UnitZ(Factor=material_thicknesss_2)

# ----
rotate_axis_2 = RotateAxis(Geometry=linear_array_3.Geometry, Angle=degrees(Slider(180, range=0..1000)), Axis=Line((0, 0, 0), (10, 0, 0)))  # -> Geometry, Transform

# ---- group: Insert base (continued)
move_8 = Move(Geometry=rotate_axis_2.Geometry, Motion=vector_xyz_4.Vector)  # -> Geometry, Transform
extrude_4 = Extrude(Base=move_8.Geometry, Direction=unit_z_4)
cap_holes_4 = CapHoles(Brep=extrude_4)

# ---- group: Insert friction
base_width_8_2 = Slider(8, range=0..10)
insert_base_1 = Slider(-1, range=-20..10)
division_13 = Division(A=base_size_5, B=base_width_8_2)
division_14 = Division(A=division_7, B=insert_base_1)
vector_xyz_11 = VectorXYZ(XComponent=division_10, YComponent=division_14, ZComponent=0)  # -> Vector, Length
rectangle_7 = Rectangle(Plane=PlaneXY(0, 0, 0), XSize=division_7, YSize=division_13, Radius=division_8)  # -> Rectangle, Length
n_5 = Slider(2, range=0..10)
move_9 = Move(Geometry=rectangle_7.Rectangle, Motion=vector_xyz_11.Vector)  # -> Geometry, Transform
vector_xyz_12 = VectorXYZ(XComponent=division_11, YComponent=0, ZComponent=0)  # -> Vector, Length
linear_array_4 = LinearArray(Geometry=move_9.Geometry, Direction=vector_xyz_12.Vector, Count=n_5)  # -> Geometry, Transform
unit_z_5 = UnitZ(Factor=material_thicknesss_4)
rotate_axis_3 = RotateAxis(Geometry=linear_array_4.Geometry, Angle=degrees(Slider(180, range=0..1000)), Axis=Line((0, 0, 0), (10, 0, 0)))  # -> Geometry, Transform

# ----
move_10 = Move(Geometry=rotate_axis_3.Geometry, Motion=vector_xyz_3.Vector)  # -> Geometry, Transform

# ---- group: Insert friction (continued)
extrude_5 = Extrude(Base=move_10.Geometry, Direction=unit_z_5)
cap_holes_5 = CapHoles(Brep=extrude_5)

# ---- group: Tabs
base_width_4_4 = Slider(4, range=0..10)
sides = Slider(6, range=0..10)
piece_width_2_2 = Slider(2, range=0..10)
division_15 = Division(A=base_size_7, B=base_width_4_4)
polygon = Polygon(Plane=PlaneXY(0, 0, 0), Radius=division_15, Segments=sides, FilletRadius=0)  # -> Polygon, Length
vector_xyz_13 = VectorXYZ(XComponent=division_15, YComponent=0, ZComponent=0)  # -> Vector, Length
division_16 = Division(A=base_size_7, B=piece_width_2_2)
vector_xyz_14 = VectorXYZ(XComponent=division_16, YComponent=0, ZComponent=0)  # -> Vector, Length
move_11 = Move(Geometry=polygon.Polygon, Motion=vector_xyz_13.Vector)  # -> Geometry, Transform
n_6 = Slider(2, range=0..10)
linear_array_5 = LinearArray(Geometry=move_11.Geometry, Direction=vector_xyz_14.Vector, Count=n_6)  # -> Geometry, Transform
unit_z_6 = UnitZ(Factor=material_thickness_2)

# ----
rotate_axis_4 = RotateAxis(Geometry=linear_array_5.Geometry, Angle=degrees(Slider(180, range=0..1000)), Axis=Line((0, 0, 0), (10, 0, 0)))  # -> Geometry, Transform

# ---- group: Tabs (continued)
extrude_6 = Extrude(Base=rotate_axis_4.Geometry, Direction=unit_z_6)
cap_holes_6 = CapHoles(Brep=extrude_6)

# ----
solid_difference_2 = SolidDifference(BrepsA=cap_holes_6, BrepsB=cap_holes_3)
solid_union = SolidUnion(Breps=[solid_difference_2, cap_holes_4, cap_holes_5, solid_difference, move_5.Geometry, box_rectangle])

# ---- group: Triangles / Score path
number_slider_2 = Slider(2, range=0..10)
y = Slider(0, range=-10..10)
construct_point_5 = ConstructPoint(XCoordinate=base_size_8, YCoordinate=y, ZCoordinate=material_thickness_3)

# ---- group: Triangles
division_17 = Division(A=base_size_8, B=number_slider_2)
n_7 = Slider(0, range=0..20)
vector_xyz_15 = VectorXYZ(XComponent=base_size_8, YComponent=n_7, ZComponent=0)  # -> Vector, Length

# ---- group: Triangles / Score path (continued)
construct_point_6 = ConstructPoint(XCoordinate=division_17, YCoordinate=base_size_8, ZCoordinate=material_thickness_3)
line_3 = Line(StartPoint=construct_point_5, EndPoint=construct_point_6)

# ---- group: Triangles (continued)
right_dash_3 = DashPattern(Curve=line_3, Pattern=linear_array.Geometry)  # -> Dashes, Gaps
mirror_2 = Mirror(Geometry=right_dash_3.Dashes, Plane=PlaneYZ(0, 0, 0))  # -> Geometry, Transform
left_dash_move = Move(Geometry=mirror_2.Geometry, Motion=vector_xyz_15.Vector)  # -> Geometry, Transform

# ----
merge = Merge(
    Data1=right_dash_3.Dashes,
    Data2=left_dash_move.Geometry,
    Data3=move_2.Geometry,
    Data4=right_dash.Dashes,
    Data5=move_3.Geometry)
