# Grasshopper definition A4.gh (Grasshopper 1.0.8)

slot_width = Slider(8, range=0..10)
end_bit_radius = Slider(0.5, range=0..10)
material = Slider(1.4, range=0..10)
# Step 1
# Input dimensions
base_size = Slider(24, range=0..30)
slot_width_2 = Panel(slot_width)
end_bit = Panel(end_bit_radius)
material_2 = Panel(material)
base_size_2 = Panel(base_size)
slot_width_3 = Panel(slot_width_2)
material_3 = Panel(material_2)
end_bit_2 = Panel(end_bit)

# ---- group: Dogbones
# Dogbone Left
# Dogbone Right
circle = Circle(Plane=PlaneXY(0, 0, 0), Radius=end_bit_2)
subtraction = Subtraction(A=slot_width_3, B=end_bit_2)
vector_xyz = VectorXYZ(XComponent=end_bit_2, YComponent=material_3, ZComponent=0)  # -> Vector, Length
vector_xyz_2 = VectorXYZ(XComponent=subtraction, YComponent=material_3, ZComponent=0)  # -> Vector, Length
move = Move(Geometry=circle, Motion=vector_xyz.Vector)  # -> Geometry, Transform
move_2 = Move(Geometry=circle, Motion=vector_xyz_2.Vector)  # -> Geometry, Transform

# ----
base_size_3 = Panel(base_size_2)
end_bit_3 = Panel(end_bit)
material_4 = Panel(material_2)
slot_width_4 = Panel(slot_width_2)
material_5 = Panel(material_2)
slot_width_5 = Panel(slot_width_2)
base_size_4 = Panel(base_size_2)
i = Slider(-1, range=-20..1)
unit_y = UnitY(Factor=i)
# Step 2
# Adjust threshold for fit
threshold_for_fit = Slider(0.12, range=0..20)
unit_x = UnitX(Factor=base_size_3)

# ---- group: Face A
# Cube face
# Individual slot
# Corner slot
# Bottom slots
# Slot base
# Top slots
i_2 = Slider(1, range=0..1)
addition = Addition(A=material_5, B=i_2)
rectangle = Rectangle(Plane=PlaneXY(0, 0, 0), XSize=slot_width_4, YSize=addition, Radius=0)  # -> Rectangle, Length
unit_x_2 = UnitX(Factor=base_size_4)
unit_y_2 = UnitY(Factor=base_size_4)
rectangle_2 = Rectangle(Plane=PlaneXY(0, 0, 0), XSize=base_size_4, YSize=base_size_4, Radius=0)  # -> Rectangle, Length

# ----
move_3 = Move(Geometry=rectangle.Rectangle, Motion=unit_y)  # -> Geometry, Transform

# ---- group: Face B
# Slot base
# Individual slot
# Bottom slot
# Right slot
# Top slot
# Top left slot
# Bottom left slot
# Cube face
i_3 = Slider(1, range=0..10)
i_4 = Slider(-1, range=-20..1)
addition_2 = Addition(A=material_4, B=i_3)
rectangle_3 = Rectangle(Plane=PlaneXY(0, 0, 0), XSize=slot_width_5, YSize=addition_2, Radius=0)  # -> Rectangle, Length
unit_y_3 = UnitY(Factor=i_4)
x = Slider(3, range=0..10)
move_4 = Move(Geometry=rectangle_3.Rectangle, Motion=unit_y_3)  # -> Geometry, Transform
division = Division(A=base_size_3, B=x)
solid_union = SolidUnion(Breps=[move_2.Geometry, move.Geometry, move_4.Geometry])
unit_x_3 = UnitX(Factor=division)
unit_x_4 = UnitX(Factor=base_size_3)
division_2 = Division(A=base_size_3, B=Slider(3, range=0..10))
vector_xyz_3 = VectorXYZ(XComponent=base_size_3, YComponent=division_2, ZComponent=0)  # -> Vector, Length
multiplication = Multiplication(A=base_size_3, B=Slider(-1, range=-20..1))
addition_3 = Addition(A=slot_width_5, B=multiplication)
unit_y_4 = UnitY(Factor=addition_3)
rectangle_4 = Rectangle(Plane=PlaneXY(0, 0, 0), XSize=base_size_3, YSize=base_size_3, Radius=0)  # -> Rectangle, Length

# ----
offset_curve = OffsetCurve(Curve=solid_union, Distance=threshold_for_fit, Corners=1)

# ---- group: Face A (continued)
solid_union_2 = SolidUnion(Breps=[move_2.Geometry, move_3.Geometry])

# ----
offset_curve_2 = OffsetCurve(Curve=solid_union_2, Distance=threshold_for_fit, Corners=1)

# ---- group: Face B (continued)
move_5 = Move(Geometry=offset_curve, Motion=unit_x_3)  # -> Geometry, Transform
rotate = Rotate(Geometry=move_5.Geometry, Angle=1.570796327, Plane=PlaneXY(0, 0, 0))  # -> Geometry, Transform
move_6 = Move(Geometry=rotate.Geometry, Motion=unit_x_4)  # -> Geometry, Transform
rotate_2 = Rotate(Geometry=move_6.Geometry, Angle=1.570796327, Plane=PlaneXY(0, 0, 0))  # -> Geometry, Transform
move_7 = Move(Geometry=rotate_2.Geometry, Motion=unit_x)  # -> Geometry, Transform
rotate_3 = Rotate(Geometry=move_7.Geometry, Angle=1.570796327, Plane=PlaneXY(0, 0, 0))  # -> Geometry, Transform
move_8 = Move(Geometry=rotate_3.Geometry, Motion=vector_xyz_3.Vector)  # -> Geometry, Transform
move_9 = Move(Geometry=move_8.Geometry, Motion=unit_y_4)  # -> Geometry, Transform
merge = Merge(Data5=move_7.Geometry, Data6=move_6.Geometry, Data7=move_5.Geometry)

# ---- group: To ensure continuous cut
subtraction_2 = Subtraction(A=slot_width_5, B=Slider(1, range=0..1))
unit_y_5 = UnitY(Factor=subtraction_2)
move_10 = Move(Geometry=move_8.Geometry, Motion=unit_y_5)  # -> Geometry, Transform
unit_y_6 = UnitY(Factor=Slider(0.13, range=0..1))
linear_array = LinearArray(Geometry=move_10.Geometry, Direction=unit_y_6, Count=Slider(16, range=-100..100))  # -> Geometry, Transform

# ---- group: Face A (continued)
rotate_4 = Rotate(Geometry=offset_curve_2, Angle=degrees(Slider(90, range=0..100)), Plane=PlaneXY(0, 0, 0))  # -> Geometry, Transform
mirror = Mirror(Geometry=rotate_4.Geometry, Plane=PlaneYZ(0, 0, 0))  # -> Geometry, Transform

# ----
region_union = RegionUnion(Curves=[mirror.Geometry, offset_curve_2])

# ---- group: Face A (continued)
mirror_2 = Mirror(Geometry=region_union, Plane=PlaneYZ(0, 0, 0))  # -> Geometry, Transform
move_11 = Move(Geometry=mirror_2.Geometry, Motion=unit_x_2)  # -> Geometry, Transform

# ----
region_union_2 = RegionUnion(Curves=[move_11.Geometry, region_union])

# ---- group: Face A (continued)
rotate_axis = RotateAxis(Geometry=region_union_2, Angle=degrees(Slider(180, range=0..1000)), Axis=Line((0, 0, 0), (10, 0, 0)))  # -> Geometry, Transform
move_12 = Move(Geometry=rotate_axis.Geometry, Motion=unit_y_2)  # -> Geometry, Transform
merge_2 = Merge(Data1=region_union_2, Data2=move_12.Geometry)

# ----
# Step 3
# Bake this (side A)
region_difference = RegionDifference(CurvesA=rectangle_2.Rectangle, CurvesB=merge_2)

# ---- group: To ensure continuous cut
multiplication_2 = Multiplication(A=slot_width_5, B=Slider(-1, range=-10..1))
unit_y_7 = UnitY(Factor=Slider(-0.13, range=-10..1))

# ----
addition_4 = Addition(A=multiplication_2, B=Slider(1, range=0..1))

# ---- group: To ensure continuous cut (continued)
unit_y_8 = UnitY(Factor=addition_4)
move_13 = Move(Geometry=move_9.Geometry, Motion=unit_y_8)  # -> Geometry, Transform
linear_array_2 = LinearArray(Geometry=move_13.Geometry, Direction=unit_y_7, Count=Slider(6, range=0..100))  # -> Geometry, Transform

# ---- group: Face B (continued)
region_union_3 = RegionUnion(Curves=[move_8.Geometry, linear_array.Geometry])
region_union_4 = RegionUnion(Curves=[move_9.Geometry, linear_array_2.Geometry])
region_difference_2 = RegionDifference(CurvesA=rectangle_4.Rectangle, CurvesB=[region_union_4, region_union_3])

# ----
# Step 3
# Bake this (side B)
region_difference_3 = RegionDifference(CurvesA=region_difference_2, CurvesB=merge)
