# Grasshopper definition tflo-A8.gh (Grasshopper 1.0.8)

case_base_inner_length = Slider(120, range=16..200)
case_base_inner_lip_height = Slider(2, range=0..4)
# Magnet cover
magnet_top_cover_layer = Slider(1.2, range=1.2..4)
# Magnet enclosures
space_between_magnet_and_inner_wall = Slider(1.5, range=0.5..2)
magnet_height = Slider(9.52, range=9.52..10)
case_base_inner_width = Slider(60, range=8..120)
magnet_thickness = Slider(2.7, range=2.7..5)
magnet_length = Slider(29.03, range=29.03..30)
case_base_inner_lip_thickness = Slider(1.59, range=1..3)
case_base_corners = Slider(6, range=2..12)
case_base_thickness = Slider(6, range=4..10)
case_base_inner_lip_thickness_2 = Panel(case_base_inner_lip_thickness)
case_base_height = Slider(31, range=28..40)
case_base_inner_width_2 = Panel(case_base_inner_width)
case_base_inner_width_3 = Panel(case_base_inner_width)
# case - base
case_base_inner_length_2 = Panel(case_base_inner_length)
magnet_enclosure_threshold = Slider(0.2, range=0.1..2)
magnet_cover = Panel(magnet_top_cover_layer)
case_inner_width = Panel(case_base_inner_width)

# ----
# Hinge - Male
hinge_size = Slider(4, range=0..10)
hinge_depth = Slider(3, range=-10..10)
case_base_inner_width_4 = Panel(case_base_inner_width)
division = Division(A=hinge_size, B=hinge_depth)
female = Panel(division)
sphere = Sphere(Base=PlaneXY(0, 0, 0), Radius=hinge_size)
hinge_depth_2 = Slider(-1, range=-10..10)
multiplication = Multiplication(A=female, B=hinge_depth_2)
multiplication_2 = Multiplication(A=female, B=Slider(2, range=0..10))
addition = Addition(A=case_base_inner_width_4, B=multiplication_2)
vector_xyz = VectorXYZ(XComponent=Slider(8, range=0..30), YComponent=multiplication, ZComponent=Slider(23, range=20..35))  # -> Vector, Length
unit_y = UnitY(Factor=addition)
move = Move(Geometry=sphere, Motion=vector_xyz.Vector)  # -> Geometry, Transform
move_2 = Move(Geometry=move.Geometry, Motion=unit_y)  # -> Geometry, Transform
merge = Merge(Data1=move.Geometry, Data2=move_2.Geometry)

# ----
# Worther
# Bake - Worther pencil
threshold_fit = Slider(0.275, range=0.025..2)
curve = Curve(<curve referenced from the Rhino model>)
curve_2 = Curve(<curve referenced from the Rhino model>)
offset_curve = OffsetCurve(Curve=curve, Distance=threshold_fit, Corners=1)
offset_curve_2 = OffsetCurve(Curve=curve_2, Distance=threshold_fit, Corners=1)
curve_3 = Curve(<curve referenced from the Rhino model>)
offset_curve_3 = OffsetCurve(Curve=curve_3, Distance=threshold_fit, Corners=1)
curve_4 = Curve(<curve referenced from the Rhino model>)
curve_5 = Curve(<curve referenced from the Rhino model>)
offset_curve_4 = OffsetCurve(Curve=curve_4, Distance=threshold_fit, Corners=1)
loft = Loft(
    Curves=[offset_curve, offset_curve_2],
    Options={Adjust=False, Closed=False, LoftEnds=0, LoftSimp=0, LoftType=0, Rebuild=10, Refit=0.01})
curve_6 = Curve(<curve referenced from the Rhino model>)
offset_curve_5 = OffsetCurve(Curve=curve_5, Distance=threshold_fit, Corners=1)
offset_curve_6 = OffsetCurve(Curve=curve_6, Distance=threshold_fit, Corners=1)
loft_2 = Loft(
    Curves=[offset_curve_3, offset_curve_4],
    Options={Adjust=False, Closed=False, LoftEnds=0, LoftSimp=0, LoftType=0, Rebuild=10, Refit=0.01})
loft_3 = Loft(
    Curves=[offset_curve_4, offset_curve_5],
    Options={Adjust=False, Closed=False, LoftEnds=0, LoftSimp=0, LoftType=0, Rebuild=10, Refit=0.01})
loft_4 = Loft(
    Curves=[offset_curve_5, offset_curve_6],
    Options={Adjust=False, Closed=False, LoftEnds=0, LoftSimp=0, LoftType=0, Rebuild=10, Refit=0.01})
cap_holes = CapHoles(Brep=[loft, loft_2, loft_3, loft_4])
solid_union = SolidUnion(Breps=cap_holes)

# ----
# Kaweco
# Bake - Kaweco pen
threshold_fit_2 = Slider(0.23, range=0.025..2)
curve_7 = Curve(<curve referenced from the Rhino model>)
curve_8 = Curve(<curve referenced from the Rhino model>)
offset_curve_7 = OffsetCurve(Curve=curve_7, Distance=threshold_fit_2, Corners=1)
offset_curve_8 = OffsetCurve(Curve=curve_8, Distance=threshold_fit_2, Corners=1)
curve_9 = Curve(<curve referenced from the Rhino model>)
curve_10 = Curve(<curve referenced from the Rhino model>)
offset_curve_9 = OffsetCurve(Curve=curve_9, Distance=threshold_fit_2, Corners=1)
curve_11 = Curve(<curve referenced from the Rhino model>)
offset_curve_10 = OffsetCurve(Curve=curve_10, Distance=threshold_fit_2, Corners=1)
curve_12 = Curve(<curve referenced from the Rhino model>)
curve_13 = Curve(<curve referenced from the Rhino model>)
offset_curve_11 = OffsetCurve(Curve=curve_11, Distance=threshold_fit_2, Corners=1)
offset_curve_12 = OffsetCurve(Curve=curve_12, Distance=threshold_fit_2, Corners=1)
loft_5 = Loft(
    Curves=[offset_curve_8, offset_curve_7],
    Options={Adjust=False, Closed=False, LoftEnds=0, LoftSimp=0, LoftType=0, Rebuild=10, Refit=0.01})
offset_curve_13 = OffsetCurve(Curve=curve_13, Distance=threshold_fit_2, Corners=1)
curve_14 = Curve(<curve referenced from the Rhino model>)
loft_6 = Loft(
    Curves=[offset_curve_9, offset_curve_8],
    Options={Adjust=False, Closed=False, LoftEnds=0, LoftSimp=0, LoftType=0, Rebuild=10, Refit=0.01})
offset_curve_14 = OffsetCurve(Curve=curve_14, Distance=threshold_fit_2, Corners=1)
loft_7 = Loft(
    Curves=[offset_curve_10, offset_curve_9],
    Options={Adjust=False, Closed=False, LoftEnds=0, LoftSimp=0, LoftType=0, Rebuild=10, Refit=0.01})
loft_8 = Loft(
    Curves=[offset_curve_11, offset_curve_10],
    Options={Adjust=False, Closed=False, LoftEnds=0, LoftSimp=0, LoftType=0, Rebuild=10, Refit=0.01})
loft_options = LoftOptions(Closed=False, Adjust=Toggle(True), Rebuild=0, Refit=0, Type=5)
loft_9 = Loft(
    Curves=[offset_curve_14, offset_curve_13],
    Options={Adjust=False, Closed=False, LoftEnds=0, LoftSimp=0, LoftType=0, Rebuild=10, Refit=0.01})
loft_10 = Loft(Curves=[offset_curve_13, offset_curve_12], Options=loft_options)
cap_holes_2 = CapHoles(Brep=[loft_5, loft_6, loft_7, loft_8, loft_10, loft_9])
solid_union_2 = SolidUnion(Breps=cap_holes_2)

addition_2 = Addition(A=magnet_thickness, B=magnet_enclosure_threshold)
addition_3 = Addition(A=magnet_length, B=magnet_enclosure_threshold)
addition_4 = Addition(A=magnet_height, B=magnet_enclosure_threshold)

# ----
# Lid
case_base_height_2 = Panel(case_base_height)
magnet_cover_2 = Panel(magnet_top_cover_layer)
magnet_threshold_height = Panel(addition_4)

# ----
# drawer - interlocking end
interlocking_width = Slider(2, range=0..10)
threshold_fit_3 = Slider(0.3, range=0..10)
# Inner edge
# To create a surface from two rectangular curves
rectangle = Rectangle(Plane=PlaneXY(0, 0, 0), XSize=case_base_inner_length_2, YSize=case_base_inner_width, Radius=0)  # -> Rectangle, Length
# Bottom surface
number_slider = Slider(2, range=0.4..3)
# Inner “box”
offset_curve_15 = OffsetCurve(Curve=rectangle.Rectangle, Distance=case_base_inner_lip_thickness, Corners=1)
magnet_cover_3 = Panel(magnet_top_cover_layer)
addition_5 = Addition(A=case_base_inner_lip_height, B=case_base_height)
merge_2 = Merge(Data1=rectangle.Rectangle, Data2=offset_curve_15)  # -> flatten(Result)
y_length = Slider(20, range=2..60)
y_length_2 = Slider(28, range=2..30)
unit_z = UnitZ(Factor=addition_5)
boundary_surfaces = BoundarySurfaces(Edges=merge_2, UseTasks=True)
extrude = Extrude(Base=boundary_surfaces, Direction=unit_z)
addition_6 = Addition(A=y_length, B=threshold_fit_3)
unit_z_2 = UnitZ(Factor=number_slider)
addition_7 = Addition(A=y_length_2, B=threshold_fit_3)
addition_8 = Addition(A=Slider(4, range=0..10), B=threshold_fit_3)
subtraction = Subtraction(A=interlocking_width, B=threshold_fit_3)
addition_9 = Addition(A=addition_8, B=threshold_fit_3)
cap_holes_3 = CapHoles(Brep=extrude)
subtraction_2 = Subtraction(A=case_inner_width, B=[y_length, addition_6])
subtraction_3 = Subtraction(A=case_inner_width, B=[y_length_2, addition_7])
rectangle_2 = Rectangle(Plane=PlaneXY(0, 0, 0), XSize=addition_3, YSize=addition_2, Radius=0)  # -> Rectangle, Length
case_height = Panel(case_base_height)
offset_curve_16 = OffsetCurve(Curve=rectangle.Rectangle, Distance=case_base_inner_lip_thickness, Corners=1)
# Outer edge
# Diff offset amts
boolean_toggle = BooleanToggle(False)
# Height minus top layer
# to cover magnets
subtraction_4 = Subtraction(A=case_base_height, B=magnet_cover_3)
case_height_minus_magnet_cover = Panel(subtraction_4)
rectangle_3 = Rectangle(Plane=PlaneXY(0, 0, 0), XSize=[addition_8, addition_9], YSize=subtraction_3, Radius=0)  # -> Rectangle, Length
rectangle_4 = Rectangle(Plane=PlaneXY(0, 0, 0), XSize=[interlocking_width, subtraction], YSize=subtraction_2, Radius=0)  # -> Rectangle, Length
box_rectangle = BoxRectangle(Rectangle=rectangle_2.Rectangle, Height=addition_4)
# To create a surface from two rectangular curves
case_height_minus_magnet_cover_2 = Panel(subtraction_4)
panel = Panel("""6
6
6
6""")
addition_10 = Addition(A=space_between_magnet_and_inner_wall, B=case_base_inner_lip_thickness_2)
box_rectangle_2 = BoxRectangle(Rectangle=rectangle_3.Rectangle, Height=case_height)
box_rectangle_3 = BoxRectangle(Rectangle=rectangle_4.Rectangle, Height=case_height)
variable_offset = VariableOffset(curve_polyline=offset_curve_16, offset_direction_toggle=boolean_toggle, offset_diatances=panel)
multiplication_3 = Multiplication(A=number_slider, B=Slider(-1, range=-1..2))
addition_11 = Addition(A=addition_10, B=addition_2)
# case - base - magnet enclosures
number_slider_2 = Slider(4, range=2..10)
fillet = Fillet(Curve=variable_offset, Radius=case_base_corners)
extrude_2 = Extrude(Base=fillet, Direction=unit_z_2)
cap_holes_4 = CapHoles(Brep=extrude_2)
unit_z_3 = UnitZ(Factor=multiplication_3)

case_width = Panel(case_base_inner_width)
pc_width = Panel(subtraction_3)
division_2 = Division(A=pc_width, B=Slider(2, range=0..10))
division_3 = Division(A=case_width, B=Slider(2, range=0..10))
subtraction_5 = Subtraction(A=division_3, B=division_2)

# ----
# Magnet cover
unit_z_4 = UnitZ(Factor=magnet_cover_3)
case_inner_length = Panel(case_base_inner_length_2)

case_width_2 = Panel(case_inner_width)
pc_width_2 = Panel(subtraction_2)
division_4 = Division(A=case_width_2, B=Slider(2, range=0..10))
division_5 = Division(A=pc_width_2, B=Slider(2, range=0..10))
subtraction_6 = Subtraction(A=division_4, B=division_5)

# ----
# To create a surface from two rectangular curves
merge_3 = Merge(Data1=offset_curve_16, Data2=fillet)  # -> flatten(Result)

addition_12 = Addition(InnerLip=case_base_inner_lip_thickness_2, CaseThickness=case_base_thickness)
multiplication_4 = Multiplication(A=addition_12, B=Slider(-1, range=-1..10))

move_3 = Move(Geometry=cap_holes_4, Motion=unit_z_3)  # -> Geometry, Transform
division_6 = Division(A=addition_3, B=Slider(2, range=2..10))
division_7 = Division(A=case_inner_length, B=number_slider_2)

division_8 = Division(A=[addition_9, addition_8], B=Slider(2, range=0..10))

multiplication_5 = Multiplication(A=addition_11, B=Slider(-1, range=-1..10))
unit_z_5 = UnitZ(Factor=case_height_minus_magnet_cover_2)
subtraction_7 = Subtraction(A=case_height_minus_magnet_cover, B=addition_4)
boundary_surfaces_2 = BoundarySurfaces(Edges=merge_3, UseTasks=True)

# ----
# Magnet cover
addition_13 = Addition(A=case_base_height_2, B=magnet_cover_2)
unit_z_6 = UnitZ(Factor=addition_13)
move_4 = Move(Geometry=boundary_surfaces_2, Motion=unit_z_6)  # -> Geometry, Transform
extrude_3 = Extrude(Base=move_4.Geometry, Direction=unit_z_4)
multiplication_6 = Multiplication(A=magnet_cover_2, B=Slider(-1, range=-1..10))
unit_z_7 = UnitZ(Factor=multiplication_6)
cap_holes_5 = CapHoles(Brep=extrude_3)

# ----
# Lid top
addition_14 = Addition(A=magnet_threshold_height, B=magnet_cover_2)
addition_15 = Addition(A=case_base_height_2, B=addition_14)
unit_z_8 = UnitZ(Factor=addition_15)
move_5 = Move(Geometry=cap_holes_4, Motion=unit_z_8)  # -> Geometry, Transform
unit_z_9 = UnitZ(Factor=addition_14)
style = ValueList({"Fillet": 1, "Chamfer": 2, "Blend": 3}, selected="Chamfer")
method = ValueList({"Ball": 1, "Edge": 2, "Rail": 3}, selected="Ball")
extrude_4 = Extrude(Base=move_4.Geometry, Direction=unit_z_9)
fillet_edge = FilletEdge(Shape=move_5.Geometry, Blend=style, Metric=method, Edges=[1, 4, 7, 10, 13, 16, 19, 22], Radii=Slider(2, range=0.8..4))
cap_holes_6 = CapHoles(Brep=extrude_4)
# Bake - Lid
solid_union_3 = SolidUnion(Breps=[cap_holes_6, fillet_edge])

deconstruct_brep = DeconstructBrep(Brep=move_5.Geometry)  # -> Faces, Edges, Vertices
size_of_text = Slider(1, range=1..6)
point_on_curve = PointOnCurve(deconstruct_brep.Edges, parameter=0.5)
point_list = PointList(Points=point_on_curve, Size=size_of_text)

extrude_5 = Extrude(Base=boundary_surfaces_2, Direction=unit_z_4)
# Bake - Lid - Magnet cover
# Once baked, run “nonmanifoldmerge” command on both polysurfaces.
# This will result in an open polysurface, but no naked edges, this should still print ok.
move_6 = Move(Geometry=cap_holes_5, Motion=unit_z_7)  # -> Geometry, Transform
subtraction_8 = Subtraction(A=division_7, B=division_6)
vector_xyz_2 = VectorXYZ(XComponent=subtraction_8, YComponent=multiplication_5, ZComponent=subtraction_7)  # -> Vector, Length

# ---- group: round out bottom edges
deconstruct_brep_2 = DeconstructBrep(Brep=move_3.Geometry)  # -> Faces, Edges, Vertices
size_of_text_2 = Slider(1, range=1..6)
point_on_curve_2 = PointOnCurve(deconstruct_brep_2.Edges, parameter=0.5)
point_list_2 = PointList(Points=point_on_curve_2, Size=size_of_text_2)

# ----
addition_16 = Addition(A=space_between_magnet_and_inner_wall, B=case_base_inner_lip_thickness_2)
unit_z_10 = UnitZ(Factor=case_height_minus_magnet_cover_2)
cap_holes_7 = CapHoles(Brep=extrude_5)
addition_17 = Addition(A=multiplication_4, B=division_8)

# ---- group: round out bottom edges
method_2 = ValueList({"Ball": 1, "Edge": 2, "Rail": 3}, selected="Ball")
style_2 = ValueList({"Fillet": 1, "Chamfer": 2, "Blend": 3}, selected="Chamfer")
fillet_edge_2 = FilletEdge(
    Shape=move_3.Geometry,
    Blend=style_2,
    Metric=method_2,
    Edges=[3, 6, 9, 12, 15, 18, 21, 23],
    Radii=Slider(2, range=0.8..4))

# ----
multiplication_7 = Multiplication(A=subtraction_8, B=Slider(2, range=0..10))
extrude_6 = Extrude(Base=boundary_surfaces_2, Direction=unit_z_5)
multiplication_8 = Multiplication(A=addition_16, B=Slider(2, range=0..10))
addition_18 = Addition(A=Slider(-2, range=-10..10), B=multiplication_4)
addition_19 = Addition(A=multiplication_7, B=addition_3)
# Bottom left
move_7 = Move(Geometry=box_rectangle, Motion=vector_xyz_2.Vector)  # -> Geometry, Transform
# Bake
move_8 = Move(Geometry=cap_holes_7, Motion=unit_z_10)  # -> Geometry, Transform
addition_20 = Addition(A=multiplication_8, B=addition_2)
vector_xyz_3 = VectorXYZ(XComponent=addition_18, YComponent=subtraction_5, ZComponent=0)  # -> Vector, Length
vector_xyz_4 = VectorXYZ(XComponent=addition_17, YComponent=subtraction_6, ZComponent=0)  # -> Vector, Length
cap_holes_8 = CapHoles(Brep=extrude_6)
unit_x = UnitX(Factor=addition_19)
addition_21 = Addition(A=case_base_inner_width_2, B=addition_20)
# Bottom right
move_9 = Move(Geometry=move_7.Geometry, Motion=unit_x)  # -> Geometry, Transform
unit_y_2 = UnitY(Factor=addition_21)
move_10 = Move(Geometry=box_rectangle_2, Motion=vector_xyz_3.Vector)  # -> Geometry, Transform
move_11 = Move(Geometry=box_rectangle_3, Motion=vector_xyz_4.Vector)  # -> Geometry, Transform
solid_union_4 = SolidUnion(Breps=[cap_holes_8, fillet_edge_2, cap_holes_3])
# Top
move_12 = Move(Geometry=[move_9.Geometry, move_7.Geometry], Motion=unit_y_2)  # -> Geometry, Transform

# ----
# Magnet enclosures
number_slider_3 = Slider(2, range=0..10)
multiplication_9 = Multiplication(A=magnet_cover_2, B=number_slider_3)
addition_22 = Addition(A=multiplication_9, B=magnet_threshold_height)
unit_z_11 = UnitZ(Factor=addition_22)
merge_magnet_enclosures = Merge(Data1=move_12.Geometry, Data2=move_9.Geometry, Data3=move_7.Geometry)
move_13 = Move(Geometry=merge_magnet_enclosures, Motion=unit_z_11)  # -> Geometry, Transform

solid_difference = SolidDifference(BrepsA=solid_union_3, BrepsB=move_13.Geometry)
# Bake
solid_union_5 = SolidUnion(Breps=[move_10.Geometry, move_11.Geometry])
merge_4 = Merge(Data1=move_9.Geometry, Data2=move_12.Geometry, Data3=move_7.Geometry)
# Bake
# Once baked, run “nonmanifoldmerge” command on both polysurfaces.
# This will result in an open polysurface, but no naked edges, this should still print ok.
solid_difference_2 = SolidDifference(MagnetTop=move_8.Geometry, InterlockingFemale=solid_union_5)
# Bake
solid_difference_3 = SolidDifference(BrepsA=solid_union_4, BrepsB=[solid_union_5, merge, merge_4])

# ==== cluster VariableOffset: Improved by Joseph Oster July 27, 2021
curve_polyline = ClusterInput()
offset_direction_toggle = ClusterInput()
offset_diatances = ClusterInput()
crv = Curve(curve_polyline)
item = ListItem(List=crv, Index=0, Wrap=True)
flip = FlipCurve(Curve=crv, Guide=item)  # -> Curve, Flag
crv_2 = Curve(graft(flip.Curve))
neg = Negative(Value=offset_diatances)
explode = Explode(Curve=crv_2, Recursive=True)  # -> Segments, Vertices
filter = StreamFilter(Gate=offset_direction_toggle, Stream0=offset_diatances, Stream1=neg)
offset = Offset(Curve=explode.Segments, Distance=filter, Plane=PlaneXY(0, 0, 0), Corners=1)
pshift = ShiftPaths(Data=offset, Offset=-1)

# ---- group: by Joseph Oster
shift = ShiftList(List=pshift, Shift=1, Wrap=True)
entwine = Entwine(Branch00=pshift, Branch01=shift, FlattenInputs=True)
flip_2 = FlipMatrix(Data=entwine)
item_2 = ListItem(List=flip_2, Index=0, Wrap=True)  # -> Item, Item1
llx = LineLine(Line1=item_2.Item, Line2=item_2.Item1)  # -> ParamA, ParamB, PointA, PointB
pline = PolyLine(Vertices=flatten(llx.PointA), Closed=invert(False))

# ----
resulting_variable_offset_curve = ClusterOutput(pline)
